# Dynamo graph 01_niveles_grilla.dyn (Dynamo 4.0.0.0)
# Crea Levels y Grids en Revit 2027. Generado por py-building-gen. Ejecutar primero.

pisos_tipo = CodeBlock { 6; }
altura_pb_m = CodeBlock { 3.5; }
altura_tipo_m = CodeBlock { 2.8; }
tiene_subsuelo = CodeBlock { false; }
cant_subsuelos = CodeBlock { 0; }
tiene_azotea = CodeBlock { true; }
crear_niveles = Python()  # PythonNet3; unwired: IN[0], IN[1], IN[2], IN[3], IN[4], IN[5]
# ---------- crear_niveles.python (67 lines) ----------
def _fi(v, d=0.0): return float(v) if v is not None else float(d)
def _ii(v, d=0):   return int(v)   if v is not None else int(d)
def _si(v, d=""):  return str(v)   if v is not None else str(d)
import clr
clr.AddReference("RevitAPI")
clr.AddReference("RevitAPIUI")
clr.AddReference("RevitServices")
from RevitServices.Persistence import DocumentManager
from Autodesk.Revit.DB import (
    Level, Transaction, XYZ, Line, Grid,
    UnitUtils, UnitTypeId,
)
import Autodesk.Revit.DB as DB

clr.AddReference("RevitServices")
from RevitServices.Persistence import DocumentManager
doc  = DocumentManager.Instance.CurrentDBDocument
uidoc = DocumentManager.Instance.CurrentUIDocument

# --- Parámetros desde nodos Code Block ---
pisos_tipo   = _ii(IN[0])
altura_pb    = _fi(IN[1])   # metros
altura_tipo  = _fi(IN[2])   # metros
tiene_sub    = bool(IN[3])
cant_sub     = _ii(IN[4])
tiene_azotea = bool(IN[5])

def m_to_ft(m: float) -> float:
    """Convierte metros a pies (unidad interna de Revit)."""
    return UnitUtils.ConvertToInternalUnits(m, UnitTypeId.Meters)

niveles_creados = []

with Transaction(doc, "py-building-gen: Niveles") as t:
    t.Start()

    # Subsuelos (debajo de +-0.00)
    for i in range(cant_sub, 0, -1):
        elev_m = -i * altura_tipo
        nombre = f"SS{i:02d}"
        lvl = Level.Create(doc, m_to_ft(elev_m))
        lvl.Name = nombre
        niveles_creados.append({"nombre": nombre, "elevacion_m": elev_m})

    # Planta baja (±0.00)
    lvl_pb = Level.Create(doc, m_to_ft(0.0))
    lvl_pb.Name = "PB"
    niveles_creados.append({"nombre": "PB", "elevacion_m": 0.0})

    # Pisos tipo
    for i in range(1, pisos_tipo + 1):
        elev_m = altura_pb + (i - 1) * altura_tipo
        nombre = f"P{i:02d}"
        lvl = Level.Create(doc, m_to_ft(elev_m))
        lvl.Name = nombre
        niveles_creados.append({"nombre": nombre, "elevacion_m": elev_m})

    # Azotea
    if tiene_azotea:
        elev_m = altura_pb + pisos_tipo * altura_tipo
        lvl = Level.Create(doc, m_to_ft(elev_m))
        lvl.Name = "AZO"
        niveles_creados.append({"nombre": "AZO", "elevacion_m": elev_m})

    t.Commit()

OUT = niveles_creados
# ----------------------------------------
frente_m = CodeBlock { 10.0; }
fondo_m = CodeBlock { 24.0; }
crear_grilla = Python()  # PythonNet3; unwired: IN[0], IN[1]
# ---------- crear_grilla.python (50 lines) ----------
def _fi(v, d=0.0): return float(v) if v is not None else float(d)
def _ii(v, d=0):   return int(v)   if v is not None else int(d)
def _si(v, d=""):  return str(v)   if v is not None else str(d)
import clr
clr.AddReference("RevitAPI")
clr.AddReference("RevitServices")
from RevitServices.Persistence import DocumentManager
from Autodesk.Revit.DB import (
    Grid, Line, XYZ, Transaction,
    UnitUtils, UnitTypeId,
)
doc = DocumentManager.Instance.CurrentDBDocument

frente_m = _fi(IN[0])
fondo_m  = _fi(IN[1])
paso_m   = 5.0

def m_to_ft(m):
    return UnitUtils.ConvertToInternalUnits(m, UnitTypeId.Meters)

grillas_creadas = []

with Transaction(doc, "py-building-gen: Grilla") as t:
    t.Start()

    # Ejes verticales (A, B, C …)
    x = 0.0; col_idx = 0
    while x <= frente_m + 0.001:
        nombre = chr(ord("A") + col_idx)
        p1 = XYZ(m_to_ft(x), m_to_ft(-1.0), 0)
        p2 = XYZ(m_to_ft(x), m_to_ft(fondo_m + 1.0), 0)
        g = Grid.Create(doc, Line.CreateBound(p1, p2))
        g.Name = nombre
        grillas_creadas.append(nombre)
        x += paso_m; col_idx += 1

    # Ejes horizontales (1, 2, 3 …)
    y = 0.0; row_idx = 1
    while y <= fondo_m + 0.001:
        nombre = str(row_idx)
        p1 = XYZ(m_to_ft(-1.0), m_to_ft(y), 0)
        p2 = XYZ(m_to_ft(frente_m + 1.0), m_to_ft(y), 0)
        g = Grid.Create(doc, Line.CreateBound(p1, p2))
        g.Name = nombre
        grillas_creadas.append(nombre)
        y += paso_m; row_idx += 1

    t.Commit()

OUT = {"ejes": grillas_creadas, "total": len(grillas_creadas)}
# ----------------------------------------
pisos_tipo_2 = CodeBlock { 6; }
tiene_azotea_2 = CodeBlock { true; }
plantas_por_disciplina = Python()  # PythonNet3; unwired: IN[0], IN[1]
# ---------- plantas_por_disciplina.python (59 lines) ----------
def _fi(v, d=0.0): return float(v) if v is not None else float(d)
def _ii(v, d=0):   return int(v)   if v is not None else int(d)
def _si(v, d=""):  return str(v)   if v is not None else str(d)
import clr
clr.AddReference("RevitAPI")
from Autodesk.Revit.DB import (
    ViewPlan, ViewFamilyType, ViewFamily, Level,
    FilteredElementCollector, Transaction,
)
clr.AddReference("RevitServices")
from RevitServices.Persistence import DocumentManager

doc = DocumentManager.Instance.CurrentDBDocument

pisos_tipo   = _ii(IN[0])
tiene_azotea = bool(IN[1])

def get_vft(familia):
    tipos = FilteredElementCollector(doc).OfClass(ViewFamilyType).ToElements()
    return next((t for t in tipos if t.ViewFamily == familia), None)

def get_level(nombre):
    levels = FilteredElementCollector(doc).OfClass(Level).ToElements()
    return next((l for l in levels if l.Name == nombre), None)

vft_arq = get_vft(ViewFamily.FloorPlan)
vft_est = get_vft(ViewFamily.StructuralPlan)   # planta estructural
vft_mep = get_vft(ViewFamily.FloorPlan)         # reutiliza FloorPlan para MEP

niveles = ["PB"] + [f"P{i:02d}" for i in range(1, pisos_tipo + 1)]
if tiene_azotea:
    niveles.append("AZO")

vistas = []

with Transaction(doc, "py-building-gen: Plantas por disciplina") as t:
    t.Start()
    for nom in niveles:
        lvl = get_level(nom)
        if lvl is None:
            continue
        for vft, prefijo in [(vft_arq, "PLANTA"), (vft_est, "EST"), (vft_mep, "MEP")]:
            if vft is None:
                continue
            nombre_vista = f"{prefijo} {nom}"
            # Verificar si ya existe una vista con ese nombre
            existente = next(
                (v for v in FilteredElementCollector(doc).OfClass(ViewPlan).ToElements()
                 if v.Name == nombre_vista), None
            )
            if existente:
                vistas.append({"nivel": nom, "tipo": prefijo, "id": existente.Id.Value, "nuevo": False})
                continue
            vista = ViewPlan.Create(doc, vft.Id, lvl.Id)
            vista.Name = nombre_vista
            vistas.append({"nivel": nom, "tipo": prefijo, "id": vista.Id.Value, "nuevo": True})
    t.Commit()

OUT = {"total": len(vistas), "detalle": vistas}
# ----------------------------------------
